# Grasshopper definition GH_UnitNumber_Example01.gh (Grasshopper 1.0.7)
# plug-ins: Units

createunit = CreateUnitNumber(Number_mm=Slider(15, range=0..100), Unit_type="Length", Measure="Millimeter")

# ---- group: Check1
un = UnitNumber(createunit)

# ----
convertunit = ConvertUnitNumber(UnitNumber=un, Select_output_unit="Centimeter")

# ---- group: Check2
num = Number(convertunit)

# ----
panel = Panel(num)
